# Grasshopper definition GrowthAlgorithm.gh (Grasshopper 1.0.8)
# plug-ins: MeshEdit Components, Anemone, Weaverbird

# ---- group: Create an initial box
number_slider = Slider(4, range=1..10)
pt = ConstructPoint(XCoordinate="0", YCoordinate="0", ZCoordinate=number_slider)
pln = Plane(PlaneXY(-0.04906572058, 0.1416683845, 0))
pl_origin = PlaneOrigin(Base=pln, Origin=pt)
box = CenterBox(Base=pl_origin, X=number_slider, Y=number_slider, Z=number_slider)
mbox = MeshBox(Base=box, XCount="1", YCount="1", ZCount="1")

# ----
mbox_2 = MeshBox(
    Base={Plane=PlaneXY(0, 0, 0), X=Domain(-10, 10), Y=Domain(-10, 10), Z=Domain(-10, 10)},
    XCount="1",
    YCount="1",
    ZCount="1")
genes = GenePool(Decimals=2, Maximum=20, Minimum=-20, Value=[-2, 6.35, 0.7, -8.99, 20, 0])
genes_2 = GenePool(
    Decimals=2,
    Maximum=20,
    Minimum=-20,
    Value=[11.44495239, 12.18781829, -16.73048111, 12.66855567, -4.888739262, 14.49945183])
mbox_3 = MeshBox(
    Base={Plane=PlaneXY(0, 0, 0), X=Domain(-10, 10), Y=Domain(-10, 10), Z=Domain(-10, 10)},
    XCount="1",
    YCount="1",
    ZCount="1")
fastloopstart = FastLoopStart(Iterations=Slider(4, range=0..5), Data=mbox_2)  # -> port, Counter, Data

wbstellate = WeaverbirdsStellateCumulation(MeshPolylines=fastloopstart.Data, Distance=Slider(10, range=0..10))

fastloopstart_2 = FastLoopStart(Iterations=Slider(5, range=0..5), Data=mbox_3)  # -> port, Counter, Data
dom = ConstructDomain(DomainStart=genes, DomainEnd=genes_2)
fastloopend = FastLoopEnd(port=fastloopstart.port, Exit=False, Data=wbstellate, RecordData=False, TimeOutVal=0)
remap = RemapNumbers(Value=Slider(0.66, range=0..1), Source=Domain(0, 1), Target=dom)  # -> Mapped, Clipped

item = ListItem(List=remap.Mapped, Index=fastloopstart_2.Counter, Wrap=True)
wbstellate_2 = WeaverbirdsStellateCumulation(MeshPolylines=fastloopstart_2.Data, Distance=item)

wbcatmullclark = WeaverbirdsCatmullClarkSubdivision(MeshCurves=fastloopend, Level=Slider(3, range=0..10), SmoothNakedEdges=1)
preview = CustomPreview(
    Geometry=wbcatmullclark,
    Material={diffuse=RGB(221, 160, 221), emission=RGB(66, 48, 66), shine=0.5, specular=RGB(255, 255, 255), transparency=0})

fastloopend_2 = FastLoopEnd(port=fastloopstart_2.port, Exit=False, Data=wbstellate_2, RecordData=False, TimeOutVal=0)
fastloopstart_3 = FastLoopStart(Iterations=Slider(4, range=0..4), Data=mbox)  # -> port, Counter, Data

pt_2 = Point(Point(0, 0, 0))
demesh = DeconstructMesh(Mesh=fastloopend_2)  # -> Vertices, Faces, Colours, Normals
dist = Distance(PointA=demesh.Vertices, PointB=pt_2)
bnd = Bounds(Numbers=dist)
remap_2 = RemapNumbers(Value=dist, Source=bnd, Target=Domain(0, 1))  # -> Mapped, Clipped
gradient = Gradient(
    LowerLimit=0,
    UpperLimit=1,
    Parameter=remap_2.Mapped,
    stops=[0: RGB(243, 57, 0), 0.1: RGB(236, 27, 60), 0.2: RGB(210, 0, 118), 0.3: RGB(103, 0, 120), 0.4: RGB(39, 72, 161), 0.5: RGB(1, 192, 229), 0.6: RGB(18, 178, 90), 0.7: RGB(79, 186, 8), 0.8: RGB(220, 237, 32), 0.9: RGB(247, 159, 20), 1: RGB(243, 57, 0)])
conmesh = ConstructMesh(Vertices=demesh.Vertices, Faces=demesh.Faces, Colours=gradient)
wbcatmullclark_2 = WeaverbirdsCatmullClarkSubdivision(MeshCurves=conmesh, Level=Slider(2, range=0..10), SmoothNakedEdges=1)
preview_2 = CustomPreview(
    Geometry=wbcatmullclark_2,
    Material={diffuse=RGB(250, 250, 250), emission=RGB(0, 0, 0), shine=1, specular=RGB(255, 255, 255), transparency=0})

# ---- group: Body
mesh = Mesh(fastloopstart_3.Data)
facen = FaceNormals(Mesh=mesh)  # -> Centers, Normals
faceb = FaceBoundaries(Mesh=mesh)
multiplication = Multiplication(A=facen.Normals, B=Slider(1.64, range=0..10))
addition = Addition(A=facen.Centers, B=multiplication)
extr = ExtrudePoint(Base=faceb, Point=addition)
smesh = SimpleMesh(Brep=extr)
mjoin = MeshJoin(Meshes=smesh)
flip = MeshFlip(Mesh=mjoin)

# ----
fastloopend_3 = FastLoopEnd(port=fastloopstart_3.port, Exit=False, Data=flip, RecordData=False, TimeOutVal=0)

wbcatmullclark_3 = WeaverbirdsCatmullClarkSubdivision(MeshCurves=fastloopend_3, Level=Slider(2, range=0..10), SmoothNakedEdges=1)
preview_3 = CustomPreview(
    Geometry=wbcatmullclark_3,
    Material={diffuse=RGB(221, 160, 221), emission=RGB(66, 48, 66), shine=0.5, specular=RGB(255, 255, 255), transparency=0})
